# Requirement set Regler_Requirements (R2025b)

## 1 [BAT_CTRL_1] Toleranz der Berechnung
Das System muss den SOC (State of Charge) der Fahrzeugbatterie mit einer Toleranz von +- 5% berechnen

## 2 [BAT_CTRL_2] Ausfallsicherheit
Das System muss bei Ausfall diesen selbstständig erkennen und an übergeordnete Systeme melden können.

## 3 [BAT_CTRL_3] Kalibrierungsmöglichkeit
Das System muss durch geschultes Personal innerhalb von 10 Minuten kalibrierbar sein

## 4 [BAT_CTRL_4] Kalibrierungsgenauigkeit
Das System muss seine Kalibrierungsgenauigkeit (Toleranz ±5%) für mindestens 24 Monate ohne Neukalibrierung beibehalten.

## 5 [BAT_CTRL_5] Reaktionszeit
Das System muss nach Power-On innerhalb von 500ms Ausgabewerte senden.