test file "EScooter_Testmanager"

suite "E Scooter Test Suite"

  case "cell_temperature_test" [baseline]
    model SOC_Regler
    input "cell_temperature_input.mat", mapped to cell_temperature -> Bus Element In3, Bus Element In1, Bus Element In2 (active)
    assessment "Assessment1": At any point of time, if cell_temperature > 90 becomes true then, with a delay of at most 1, status_flag == true must be true
      cell_temperature: signal SOC_Regler/Bus Element In3, port 1
      status_flag: signal SOC_Regler/OR, port 1

  case "battery_voltage_test" [simulation]
    model SOC_Regler
    input "battery_voltage_input.mat", mapped to cell_temperature -> Bus Element In3, battery_voltage -> Bus Element In1, battery_current -> Bus Element In2 (active)
    assessment "Assessment1": At any point of time, if battery_voltage <= 30 becomes true then, with a delay of at most 1, status_flag == true must be true
      battery_voltage: signal SOC_Regler/Bus Element In1, port 1
      status_flag: signal SOC_Regler/OR, port 1

  case "low_battery_testlow" [simulation]
    model SOC_Regler
    input "state_of_current_input.mat", mapped to cell_temperature -> Bus Element In3, battery_voltage -> Bus Element In1, battery_current -> Bus Element In2 (active)
    assessment "Assessment1": At any point of time, if state_of_current < 20 becomes true then, with a delay of at most 1, low_battery_warnflag == true must be true
      low_battery_warnflag: signal SOC_Regler/Sum, port 1
      state_of_current: signal SOC_Regler/Sum, port 1